# Dynamo graph Concatenate_Titleblock.dyn (Dynamo 0.7.2.2114)

sheets = Categories(index=733)
all_sheets = ElementsOfCategory(sheets)
string = StringInput("Sheet Name")
string_2 = StringInput("SHEET DISCIPLINE")
getParameterValueByName = Element.GetParameterValueByName(all_sheets, string_2)
string_3 = StringInput("SHEET_TITLE 1")
getParameterValueByName_2 = Element.GetParameterValueByName(all_sheets, string_3)
string_4 = StringInput("SHEET_TITLE 2")
getParameterValueByName_3 = Element.GetParameterValueByName(all_sheets, string_4)
code_block = CodeBlock(Row_1=getParameterValueByName, Row_2=getParameterValueByName_2, Row_3=getParameterValueByName_3) { Row_1+" "+Row_2+" "+Row_3; }
setParameterByName = Element.SetParameterByName(all_sheets, string, code_block)
sheetName = Sheet.SheetName(setParameterByName)
